# Grasshopper definition FacadeIterations.gh (Grasshopper 0.9.76)
# plug-ins: Kangaroo Components, Weaverbird

number_slider = Slider(6, range=0..50)
square = Square(Plane=PlaneXY(0, 0, 0), Size=1, ExtentX=number_slider, ExtentY=number_slider)  # -> Cells, Points
construct_mesh = ConstructMesh(Vertices=[Point(0, 0, 0), Point(10, 0, 0), Point(10, 10, 0), Point(0, 10, 0)], Faces={A=0, B=1, C=2, D=3})

# ---- group: ThisAintThePrettiestButItGetsThingsDone
boolean_toggle = BooleanToggle(False)
relative_item = RelativeItem(Tree=square.Points, Offset="{0;0;1}", WrapPaths=boolean_toggle, WrapItems=boolean_toggle)  # -> ItemA, ItemB
relative_item_2 = RelativeItem(Tree=square.Points, Offset="{0;0;0}[+1]", WrapPaths=boolean_toggle, WrapItems=boolean_toggle)  # -> ItemA, ItemB
relative_item_3 = RelativeItem(Tree=square.Points, Offset="{0;0;+1}[+1]", WrapPaths=boolean_toggle, WrapItems=boolean_toggle)  # -> ItemA, ItemB
relative_item_4 = RelativeItem(Tree=square.Points, Offset="{0;0;1}(-1)", WrapPaths=boolean_toggle, WrapItems=boolean_toggle)  # -> ItemA, ItemB

# ---- group: SomeComponentsWeMightOrMightNotNeedEver
point = Point(square.Points)  # disabled
boolean_toggle_2 = BooleanToggle(True)  # disabled
c_script = CSharpScript(points=point)  # -> selectedPoints; inputs points: tree of Point3d; disabled
# ---------- c_script: C# ----------
    var pointsOut = new DataTree<Point3d>();

    int branches = points.BranchCount;

    for( int i = 0; i < branches; ++i )
    {

      var path = new GH_Path(i);

      for( int j = 0; j < points.Branch(i).Count; ++j )
      {


        if( i % 2 != 0 && j % 2 != 0 )

          pointsOut.Add(points.Branch(i)[j], path);


      }

    }

    selectedPoints = pointsOut;
# ---------- end c_script ----------
getmebranches = CSharpScript(tree=square.Points, clockWise=boolean_toggle_2)  # -> A; inputs tree: tree of Point3d, clockWise: Boolean; disabled
# ---------- getmebranches: C# ----------
    var linesOut = new DataTree<Point3d>();

    var branches = tree.BranchCount;

    int x = 0, y = 0;

    bool flag = clockWise;

    if( flag == true )
    {

      x = 0; y = 1;

    }

    if( flag == false )
    {

      x = 1; y = 0;

    }

    for( int i = 0; i < branches; ++i )
      for( int j = 0; j < tree.Branch(i).Count; ++j )
      {

        var path = new GH_Path(i);

        if( i % 2 != 0 && j % 2 != x )
          if( flag == true )

            linesOut.Add(tree.Branch(i)[j], path);

          else
          {

            linesOut.Add(tree.Branch(i)[j], path);

          }

        if( i % 2 != 1 && j % 2 != y )
          if( flag == true )

            linesOut.Add(tree.Branch(i)[j], path);

          else
          {

            linesOut.Add(tree.Branch(i)[j], path);

          }

      }

    A = linesOut;
# ---------- end getmebranches ----------
unit_z = UnitZ(Factor=1)  # disabled
number_slider_2 = Slider(1, range=0..1)  # disabled
move = Move(Geometry=c_script, Motion=unit_z)  # -> Geometry, Transform; disabled
point_list = PointList(Points=c_script, Size=number_slider_2)  # disabled
point_list_2 = PointList(Points=getmebranches, Size=number_slider_2)  # disabled

# ---- group: GiveMeThemLines
line = Line(StartPoint=relative_item_3.ItemA, EndPoint=relative_item_3.ItemB)  # -> simplify(Line)
line_2 = Line(StartPoint=relative_item_4.ItemA, EndPoint=relative_item_4.ItemB)  # -> simplify(Line)
line_3 = Line(StartPoint=relative_item.ItemA, EndPoint=relative_item.ItemB)  # -> simplify(Line)
line_4 = Line(StartPoint=relative_item_2.ItemA, EndPoint=relative_item_2.ItemB)  # -> simplify(Line)
getmebranches_2 = CSharpScript(tree=line, clockWise=Toggle(True))  # -> A; inputs tree: tree of Line, clockWise: Boolean
# ---------- getmebranches_2: C# ----------
    var linesOut = new DataTree<Line>();

    var branches = tree.BranchCount;

    int x = 0, y = 0;

    bool flag = clockWise;

    if( flag == true )
    {

      x = 0; y = 1;

    }

    if( flag == false )
    {

      x = 1; y = 0;

    }

    for( int i = 0; i < branches; ++i )
      for( int j = 0; j < tree.Branch(i).Count; ++j )
      {

        var path = new GH_Path(i);

        if( i % 2 != 0 && j % 2 != x )
          if( flag == true )

            linesOut.Add(tree.Branch(i)[j], path);

          else
          {

            linesOut.Add(tree.Branch(i)[j], path);

          }

        if( i % 2 != 1 && j % 2 != y )
          if( flag == true )

            linesOut.Add(tree.Branch(i)[j], path);

          else
          {

            linesOut.Add(tree.Branch(i)[j], path);

          }

      }

    A = linesOut;
# ---------- end getmebranches_2 ----------
getmebranches_3 = CSharpScript(tree=line_2, clockWise=Toggle(False))  # -> A; inputs tree: tree of Line, clockWise: Boolean; same code as getmebranches_2

# ---- group: GiveMeAMesh
weaverbird_s_mesh_from_lines_weave_back = WeaverbirdsMeshFromLinesWeaveBack(Lines=flatten([getmebranches_3, getmebranches_2, line_4, line_3]), MaximumValence=Slider(3, range=0..5))

# ----
line_5 = Line([line_3, line_4, getmebranches_2, getmebranches_3])
hingepoints = HingePoints(Mesh=weaverbird_s_mesh_from_lines_weave_back)  # -> _1, _2, _3, _4
tri = Triangulate(Mesh=weaverbird_s_mesh_from_lines_weave_back)  # -> Mesh, Count
springsfrommesh = SpringsFromMesh(M=tri.Mesh, stiffness=100, B=1)
hinge = Hinge(Point1=hingepoints._1, Point2=hingepoints._2, Point3=hingepoints._3, Point4=hingepoints._4, Strength=500, RestAngle=0)
data = Data([springsfrommesh, hinge])

# ---- group: SimulateMyOrigami
radians = Radians(Degrees=Slider(1000, range=0..1000))
radians_2 = Radians(Degrees=Slider(1000, range=0..1000))
origami = Origami(
    mesh=weaverbird_s_mesh_from_lines_weave_back,
    C=line_5,
    num_4=radians,
    C_2=line_5,
    num_2=radians_2,
    num=Slider(10, range=0..10))  # -> data_2, R
timer = Timer(TimerInterval=20, Target=kangaroophysics)  # disabled
kangaroophysics = KangarooPhysics(ForceObjects=data, Settings=null, Geometry=origami.R, SimulationReset=Toggle(True))  # -> Out, Iterations, ParticlesOut, GeometryOut, KE

# ==== cluster Origami: Fold a flat pattern into 3d origami
mesh = ClusterInput()
mesh_2 = Mesh(mesh)
num = ClusterInput()
num_2 = ClusterInput()
hingepoints = HingePoints(Mesh=mesh_2)  # -> _1, _2, _3, _4
strength = Panel("1")
num_3 = Number(num)
C = ClusterInput()
C_2 = ClusterInput()
num_4 = ClusterInput()
strength_2 = Panel("1")
num_5 = Number(num_2)
num_6 = Number(strength)
eval = EvaluateCurve(Curve=reparameterize(C), Parameter=0.5)  # -> Point, Tangent, Angle
eval_2 = EvaluateCurve(Curve=reparameterize(C_2), Parameter=0.5)  # -> Point, Tangent, Angle
ln = Line(StartPoint=hingepoints._1, EndPoint=hingepoints._2)
num_7 = Number(num_4)
num_8 = Number(strength_2)
tri = Triangulate(Mesh=mesh_2)  # -> Mesh, Count
multiplication = Multiplication(A=num_7, B=num_3)
multiplication_2 = Multiplication(A=num_5, B=num_3)
eval_3 = EvaluateCurve(Curve=reparameterize(ln), Parameter=0.5)  # -> graft(Point), Tangent, Angle
springsfrommesh = SpringsFromMesh(M=tri.Mesh, stiffness=100, B=1)
planarizequads = PlanarizeQuads(M=mesh_2, planarizestrength=1000)
unweld = UnweldMesh(Mesh=mesh_2, Angle=0)
cp = ClosestPoint(Point=eval_3.Point, Cloud=eval_2.Point)  # -> ClosestPoint, CPIndex, Distance
cp_2 = ClosestPoint(Point=eval_3.Point, Cloud=eval.Point)  # -> ClosestPoint, CPIndex, Distance
R = ClusterOutput(unweld)
larger = LargerThan(FirstNumber=0.01, SecondNumber=cp.Distance)  # -> LargerThan, OrEqualTo
larger_2 = LargerThan(FirstNumber=0.01, SecondNumber=cp_2.Distance)  # -> LargerThan, OrEqualTo
cull = CullPattern(List=num_8, CullPattern=larger_2.LargerThan)
cull_2 = CullPattern(List=multiplication, CullPattern=larger_2.LargerThan)
cull_3 = CullPattern(List=num_6, CullPattern=larger.LargerThan)
cull_4 = CullPattern(List=multiplication_2, CullPattern=larger.LargerThan)
addition = Addition(A=cull, B=cull_3)
addition_2 = Addition(A=cull_2, B=cull_4)
addition_3 = Addition(A=0, B=addition)  # -> flatten(Result)
addition_4 = Addition(A=0, B=addition_2)  # -> flatten(Result)
hinge = Hinge(
    Point1=hingepoints._1,
    Point2=hingepoints._2,
    Point3=hingepoints._3,
    Point4=hingepoints._4,
    Strength=addition_3,
    RestAngle=addition_4)
data = Data([springsfrommesh, hinge, planarizequads])
data_2 = ClusterOutput(data)

# ==== cluster PlanarizeQuads: Applies a planarization force to any quads in a mesh
M = ClusterInput()
mcomp = Decompose(Mesh=M)  # -> Vertices, Faces, Colours, Normals
vertices = FaceVertices(Face=mcomp.Faces)  # -> CornerA, CornerB, CornerC, CornerD
planarizestrength = ClusterInput()
item = ListItem(List=mcomp.Vertices, Index=vertices.CornerA, Wrap=False)
item_2 = ListItem(List=mcomp.Vertices, Index=vertices.CornerB, Wrap=False)
item_3 = ListItem(List=mcomp.Vertices, Index=vertices.CornerC, Wrap=False)
item_4 = ListItem(List=mcomp.Vertices, Index=vertices.CornerD, Wrap=False)
planarize = Planarize(Point1=item, Point2=item_2, Point3=item_3, Point4=item_4, PlanarizeStrength=planarizestrength)
equals = Equality(FirstNumber=vertices.CornerC, SecondNumber=vertices.CornerD)  # -> Equality, Inequality
cull = CullPattern(List=planarize, CullPattern=equals.Inequality)
L = ClusterOutput(cull)

# ==== cluster SpringsFromMesh: Turns all edges of a mesh into springs
M = ClusterInput()
medges = MeshEdges(Mesh=M)  # -> NakedEdges, InteriorEdges, NonManifoldEdges
crv = Curve([medges.NakedEdges, medges.InteriorEdges])
B = ClusterInput()
len = Length(Curve=crv)
multiplication = Multiplication(A=len, B=B)
stiffness = ClusterInput()
springs = SpringsFromLine(Connection=crv, Stiffness=stiffness, Damping=10, RestLength=multiplication, UpperCutoff=0, LowerCutoff=0, Plasticity=0)
S = ClusterOutput(springs)
