# Grasshopper definition FacadeIterationsTwo.gh (Grasshopper 0.9.76)
# plug-ins: Python Interpreter, Weaverbird, Kangaroo2 Components

number_slider = Slider(10, range=0..10)
number_slider_2 = Slider(10, range=0..10)
number_slider_3 = Slider(32, range=0..200)
xy = XYPlane(Origin=Point(0, 0, 0))
xz = XZPlane(Origin=Point(0, 0, 0))
hexagonal = Hexagonal(Plane=xz, Size=Slider(1, range=0..1), ExtentX=number_slider, ExtentY=number_slider)  # -> Cells, simplify(Points)
hexagonal_2 = Hexagonal(Plane=xz, Size=Slider(0.3, range=0..1), ExtentX=number_slider_3, ExtentY=number_slider_3)  # -> Cells, simplify(Points)
simplifybranches = CSharpScript(points=hexagonal.Points)  # -> pointsOut; inputs points: tree of Point3d
# ---------- simplifybranches: C# ----------
    int size = points.BranchCount;
    
    var finalPoints = new DataTree<Point3d>();
    
    for( int i = 0; i < size; ++i )
      for( int j = 0; j < points.Branch(i).Count; ++j )
      {
      
        finalPoints.Add( points.Branch(i)[j], new GH_Path(i) );
      
      }
    
    pointsOut = finalPoints;
# ---------- end simplifybranches ----------
simplifybranches_2 = CSharpScript(points=hexagonal_2.Points)  # -> pointsOut; inputs points: tree of Point3d; same code as simplifybranches
flatten = FlattenTree(Tree=hexagonal.Cells, Path="{0}")
point = Point(simplify(flatten(simplifybranches)))
graft = GraftTree(Tree=point, IncludeEmptyLists=True, IncludeNullItems=True)  # -> simplify(Tree)
c_script = CSharpScript(point=graft, direction=Slider(4, range=0..10))  # -> simplify(A); inputs point: tree of Point3d, direction: Int32
# ---------- c_script: C# ----------
    var vectorDir = new Point3d(0, 0, 0);

    if( direction > direction % 3 ) direction = direction % 3;

    switch( direction )
    {

      case 0: vectorDir = new Point3d(1, 0, 0);
        break;

      case 1: vectorDir = new Point3d(0, 1, 0);
        break;

      case 2: vectorDir = new Point3d(0, 0, 1);
        break;

    }

    var dataTreeOut = new DataTree<Plane>();

    for( int i = 0; i < point.BranchCount; ++i )
      for( int j = 0; j < point.Branch(i).Count; ++j )
      {

        dataTreeOut.Add(new Plane(point.Branch(i)[j], new Vector3d(vectorDir)), new GH_Path(i));
        //dataTreeOut.Graft(new GH_Path(counter), true);

      }

    A = dataTreeOut;
# ---------- end c_script ----------
polygon = Polygon(Plane=c_script, Radius=Slider(0.98, range=0..1), Segments=Slider(6, range=0..100), FilletRadius=0)  # -> Polygon, Length
radians = Radians(Degrees=Slider(0, range=0..1000))
rotate = Rotate(Geometry=polygon.Polygon, Angle=1.570796327, Plane=c_script)  # -> simplify(Geometry), Transform
number_slider_4 = Slider(10, range=0..10)  # disabled
discontinuity = Discontinuity(Curve=simplify(rotate.Geometry), Level=1)  # -> simplify(Points), simplify(Parameters)
area = Area(Geometry=rotate.Geometry)  # -> Area, Centroid
branchrearrange = CSharpScript(points=discontinuity.Points)  # -> A; inputs points: tree of Point3d
# ---------- branchrearrange: C# ----------
    var pointsOut = new DataTree<Point3d>();

    for( int i = 0; i < points.BranchCount; ++i )
      for( int j = 0; j < points.Branch(i).Count; ++j )
      {

        pointsOut.Add(points.Branch(i)[j], new GH_Path(i));

      }

    A = pointsOut;
# ---------- end branchrearrange ----------
line = Line(StartPoint=graft(point), EndPoint=branchrearrange)  # -> simplify(Line)
shatter = Shatter(Curve=rotate.Geometry, Parameters=discontinuity.Parameters)  # -> simplify(Segments)
branchrearrange_2 = CSharpScript(lines=line)  # -> A; inputs lines: tree of Line
# ---------- branchrearrange_2: C# ----------
    var linesOut = new DataTree<Line>();
    
    for( int i = 0; i < lines.BranchCount; ++i )
      for( int j = 0; j < lines.Branch(i).Count; ++j )
      {
      
        linesOut.Add( lines.Branch(i)[j], new GH_Path(i) );
      
      }
    
    A = linesOut;
# ---------- end branchrearrange_2 ----------
branchrearrange_3 = CSharpScript(lines=shatter)  # -> A; inputs lines: tree of Line; same code as branchrearrange_2
join = JoinCurves(Curves=branchrearrange_3, Preserve=False)
evaluate_curve = EvaluateCurve(Curve=reparameterize(branchrearrange_3), Parameter=Slider(0.5, range=0..1))  # -> Point, Tangent, Angle
brep = Brep(join)
c_script_2 = CSharpScript(points=evaluate_curve.Point)  # -> selectedPoints; inputs points: list of Point3d
# ---------- c_script_2: C# ----------
    var pointsOut = new List<Point3d>();

    int size = points.Count;

    for( int i = 0; i < size; ++i )
    {
      if( i % 5 != 0 )

        //if( i % 3 != 0 )
        
        pointsOut.Add(points[i]);

    }

    selectedPoints = pointsOut;
# ---------- end c_script_2 ----------
c_script_3 = CSharpScript(points=area.Centroid)  # -> selectedPoints; inputs points: tree of Point3d
# ---------- c_script_3: C# ----------
    var pointsOut = new DataTree<Point3d>();

    int size = points.BranchCount;

    for( int i = 0; i < size; ++i )
    {

      for( int j = 0; j < points.Branch(i).Count; ++j )

        //if( i % size != 0 )

          pointsOut.Add(points.Branch(i)[j], new GH_Path(i));

    }

    selectedPoints = pointsOut;
# ---------- end c_script_3 ----------
c_script_4 = CSharpScript(points=evaluate_curve.Point)  # -> selectedPoints; inputs points: tree of Point3d; same code as c_script_3
line_2 = Line(StartPoint=c_script_3, EndPoint=c_script_4)
branchrearrange_4 = CSharpScript(lines=line_2)  # -> A; inputs lines: tree of Line; same code as branchrearrange_2
ln = Line(StartPoint=area.Centroid, EndPoint=c_script_2)
points = PointList(Points=c_script_2, Size=Slider(0.408, range=0..1))
crv = Curve([branchrearrange_4, branchrearrange_3])
eval = EvaluateCurve(Curve=reparameterize(crv), Parameter=Slider(1, range=0..1))  # -> Point, Tangent, Angle
pt = Point([eval.Point, area.Centroid])
meshertree = CSharpScript(points=pt)  # -> simplify(graft(meshOut)); inputs points: tree of Point3d
# ---------- meshertree: C# ----------
    int size = points.BranchCount;

    var mesh = new Mesh[size];

    var organized = new Point3d[size][];

    for( int i = 0; i < size; ++i )
    {

      mesh[i] = new Mesh();
      mesh[i].Vertices.AddVertices(points.Branch(i));

      mesh[i].Faces.AddFace(12, 0, 6);
      mesh[i].Faces.AddFace(12, 6, 1, 7);
      mesh[i].Faces.AddFace(12, 7, 2);
      mesh[i].Faces.AddFace(12, 2, 8);
      mesh[i].Faces.AddFace(12, 8, 3);
      mesh[i].Faces.AddFace(12, 3, 9);
      mesh[i].Faces.AddFace(12, 9, 4, 10);
      mesh[i].Faces.AddFace(12, 10, 5);
      mesh[i].Faces.AddFace(12, 5, 11);
      mesh[i].Faces.AddFace(12, 11, 0);

    }

    meshOut = mesh;
# ---------- end meshertree ----------

# ---- group: LadybugFly
open_weather_file = Ladybug_OpenEPWWeatherFile(open=Toggle(True))  # -> epwFile; plug-in component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
ladybug = Ladybug_Ladybug()  # -> Vviiiiiiiiiizzz; plug-in component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
importepw = Ladybug_ImportEpw(epwFile=open_weather_file)  # -> readMe, latitude, location, dryBulbTemperature, dewPointTemperature, relativeHumidity, windSpeed, windDirection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; plug-in component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
number_slider_5 = Slider(0.1, range=0..0.1)
sunpath = Ladybug_SunPath(
    location=importepw.location,
    hour=Slider(12, range=0..100),
    day=Slider(31, range=0..100),
    month=Slider(12, range=0..100),
    timeStep=Slider(1, range=0..1),
    dailyOrAnnualSunPath=True)  # -> readMe, sunVectors, sunAltitudes, sunAzimuths, port, sunSpheresMesh, sunPathCrvs, compassCrvs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; plug-in component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
mesh = Mesh()
pt_2 = Point()
Y = UnitY(Factor=1)
c_script_5 = CSharpScript(points=pt_2)  # -> flatten(selectedPoints); inputs points: tree of Point3d
# ---------- c_script_5: C# ----------
    var pointsOut = new DataTree<Point3d>();

    int branches = points.BranchCount;

    for( int i = 0; i < branches; ++i )
    {

      var path = new GH_Path(i);

      for( int j = 0; j < points.Branch(i).Count; ++j )
      {


        if( i % 2 != 0 && j % 2 != 0 )

          pointsOut.Add(points.Branch(i)[j], path);


      }

    }

    selectedPoints = pointsOut;
# ---------- end c_script_5 ----------
medges = MeshEdges()  # -> NakedEdges, InteriorEdges, NonManifoldEdges
move = Move(Geometry=c_script_5, Motion=Vector(0, 0, 10))  # -> Geometry, Transform
move_2 = Move(Geometry=c_script_5, Motion=Y)  # -> Geometry, Transform
pt_3 = Point(sunpath.sunPositions)
line_3 = Line(medges.InteriorEdges)
vec2pt = Vector2Pt(PointA=move_2.Geometry, PointB=c_script_5, Unitize=False)  # -> Vector, Length
eval_2 = EvaluateCurve(Curve=line_3, Parameter=Slider(0, range=0..1))  # -> Point, Tangent, Angle
vdis = VectorDisplay(Anchor=c_script_5, Vector=vec2pt.Vector)
meshray = MeshRay(Mesh=mesh, Point=c_script_5, Direction=vec2pt.Vector)  # -> Point, Hit
cp = ClosestPoint(Point=meshray.Point, Cloud=eval_2.Point)  # -> ClosestPoint, CPIndex, Distance
lng = ListLength(List=cp.ClosestPoint)
series = Series(Start=0, Step=1, Count=lng)
X = UnitX(Factor=series)
move_3 = Move(Geometry=pt_3, Motion=X)  # -> Geometry, Transform
vec2pt_2 = Vector2Pt(PointA=pt_3, PointB=[cp.ClosestPoint, move.Geometry], Unitize=False)  # -> Vector, Length
vdis_2 = VectorDisplay(Anchor=pt_3, Vector=vec2pt_2.Vector)

# ----
vec = Vector(sunpath.sunVectors)  # disabled
amp = Amplitude(Vector=vec, Amplitude=number_slider_4)  # disabled
vdis_3 = VectorDisplay(Anchor=area.Centroid, Vector=amp)  # disabled
branchrearrange_5 = CSharpScript(mesh=meshertree)  # -> A; inputs mesh: tree of Mesh
# ---------- branchrearrange_5: C# ----------
    var meshOut = new DataTree<Mesh>();

    for( int i = 0; i < mesh.BranchCount; ++i )
      for( int j = 0; j < mesh.Branch(i).Count; ++j )
      {

        meshOut.Add(mesh.Branch(i)[j], new GH_Path(i));

      }

    A = meshOut;
# ---------- end branchrearrange_5 ----------
lng_2 = ListLength(List=flatten)
folding = Slider(3.819, range=0..7.4)
folding_2 = Slider(0.04, range=0..10)
mesh_2 = Mesh(simplify(branchrearrange_5))
angle = Panel("pi")
angle_2 = Panel("-pi")
crv_2 = Curve(branchrearrange_2)
crv_3 = Curve(crv)
multiplication = Multiplication(A=angle_2, B=folding)
dom = ConstructDomain(DomainStart=0, DomainEnd=expr("-x", multiplication))
random = Random(Range=dom, Number=lng_2, Seed=Slider(337, range=0..1000))  # -> simplify(graft(Random))
multiplication_2 = Multiplication(A=angle_2, B=folding_2)
X_2 = UnitX(Factor=Slider(1.414, range=0..10))
move_4 = Move(Geometry=crv_2, Motion=X_2)  # -> Geometry, Transform
move_5 = Move(Geometry=crv_3, Motion=X_2)  # -> Geometry, Transform
move_6 = Move(Geometry=mesh_2, Motion=X_2)  # -> Geometry, Transform
Z = UnitZ(Factor=Slider(0.7952, range=0..2))
move_7 = Move(Geometry=move_4.Geometry, Motion=Z)  # -> Geometry, Transform
move_8 = Move(Geometry=move_5.Geometry, Motion=Z)  # -> Geometry, Transform
move_9 = Move(Geometry=move_6.Geometry, Motion=Z)  # -> Geometry, Transform
analysisperiod = Ladybug_AnalysisPeriod(
    fromMonth=Slider(0, range=0..100),
    fromDay=Slider(0, range=0..100),
    fromHour=Slider(12, range=0..100),
    toMonth=Slider(1, range=0..100),
    toDay=Slider(0, range=0..100),
    toHour=Slider(13, range=0..100))  # -> readMe, analysisPeriod; plug-in component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
crv_4 = Curve(flatten(crv_2))
mesh_3 = Mesh(flatten(mesh_2))
crv_5 = Curve(flatten(crv_3))
num = Number(random)
hingepoints = HingePoints(Mesh=mesh_3)  # -> _1, _2, _3, _4
Y_2 = UnitY(Factor=Slider(1, range=0..10))  # -> expr("-x", UnitVector)
medges_2 = MeshEdges(Mesh=mesh_3)  # -> simplify(NakedEdges), simplify(InteriorEdges), simplify(NonManifoldEdges)
demesh = DeconstructMesh(Mesh=mesh_3)  # -> simplify(Vertices), Faces, Colours, Normals
gencumulativeskymtx = Ladybug_GenCumulativeSkyMtx(epwFile=open_weather_file, skyDensity=0, useOldRes=True, runIt=Toggle(True))  # -> readMe, cumulativeSkyMtx; plug-in component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
ln_2 = Line(StartPoint=hingepoints._1, EndPoint=hingepoints._2)  # -> simplify(Line)
move_10 = Move(Geometry=simplifybranches_2, Motion=Y_2)  # -> Geometry, Transform
hinge = Hinge(
    FoldStart=simplify(hingepoints._1),
    FoldEnd=simplify(hingepoints._2),
    Tip1=simplify(hingepoints._3),
    Tip2=simplify(hingepoints._4),
    RestAngle=simplify(num),
    Strength=0.1)  # -> simplify(Hinge)
hinge_2 = Hinge(
    FoldStart=simplify(hingepoints._1),
    FoldEnd=simplify(hingepoints._2),
    Tip1=simplify(hingepoints._3),
    Tip2=simplify(hingepoints._4),
    RestAngle=simplify(num),
    Strength=0.1)  # -> simplify(Hinge)
show = Show(G=mesh_3)
eval_3 = EvaluateCurve(Curve=ln_2, Parameter=0.5)  # -> graft(Point), Tangent, Angle
eval_4 = EvaluateCurve(Curve=reparameterize(crv_5), Parameter=0.5)  # -> Point, Tangent, Angle
eval_5 = EvaluateCurve(Curve=reparameterize(crv_4), Parameter=0.5)  # -> Point, Tangent, Angle
plasticanchor = PlasticAnchor(Point=demesh.Vertices, Limit=0.01, Strength=0.001)
length_line = LengthLine(Line=[medges_2.NakedEdges, medges_2.InteriorEdges], Strength=1)
dist = Distance(PointA=eval_4.Point, PointB=eval_3.Point)
dist_2 = Distance(PointA=eval_5.Point, PointB=eval_3.Point)
selectskymtx = Ladybug_selectSkyMtx(
    cumulativeSkyMtx=gencumulativeskymtx.cumulativeSkyMtx,
    analysisPeriod=analysisperiod.analysisPeriod,
    removeDiffuse=False,
    removeDirect=False)  # -> readMe, selectedSkyMtx; plug-in component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
sort = SortList(Keys=dist)  # -> Keys, ValuesA
sort_2 = SortList(Keys=dist_2)  # -> Keys, ValuesA
pt_4 = Point(simplify(branchrearrange))
pt_5 = Point(eval.Point)
move_11 = Move(Geometry=simplifybranches_2, Motion=expr("-x*2", sunpath.sunVectors))  # -> Geometry, Transform
item = ListItem(List=sort.Keys, Index=0, Wrap=True)
item_2 = ListItem(List=sort_2.Keys, Index=0, Wrap=True)
smaller = SmallerThan(FirstNumber=item, SecondNumber=0.01)  # -> flatten(SmallerThan), OrEqualTo
smaller_2 = SmallerThan(FirstNumber=item_2, SecondNumber=0.01)  # -> flatten(SmallerThan), OrEqualTo
cull = CullPattern(List=hinge, CullPattern=smaller_2.SmallerThan)
panel = Panel("""1
4""")
cull_2 = CullPattern(List=hinge_2, CullPattern=smaller.SmallerThan)
item_3 = ListItem(List=pt_5, Index=panel, Wrap=True)  # -> simplify(Item)
pt_6 = Point(flatten([item_3, pt_4]))
anchor = Anchor(Point=pt_6, Strength=10000)
reset = Button()
number_slider_6 = Slider(180, range=0..1000)
number_slider_7 = Slider(360, range=0..1000)
data = Data([length_line, show, plasticanchor, anchor, cull_2, cull])
solver = Solver(GoalObjects=data, Reset=reset, Threshold=1e-15, Tolerance=0.01, On=Toggle(True))  # -> I, V, O
brep_2 = Brep(rotate.Geometry)
onlybreps = CSharpScript(x=solver.O)  # -> out, A; inputs x: tree
# ---------- onlybreps: C# ----------
    var meshOut = new List<object>();

    for( int i = 0; i < x.BranchCount; ++i )
      for( int j = 0; j < x.Branch(i).Count; ++j )
      {
  
        if( x.Branch(i)[j] != null )
          
          if( x.Branch(i)[j].GetType() == typeof( Rhino.Geometry.Mesh ) )
        
            meshOut.Add(x.Branch(i)[j]);
  
      }

    A = meshOut;
# ---------- end onlybreps ----------
forwardraytracing = Ladybug_ForwardRaytracing(
    startPts=move_10.Geometry,
    startVectors=graft(sunpath.sunVectors),
    context=flatten(onlybreps.A),
    numOfBounce=2,
    lastBounceLen=10)  # -> rays; plug-in component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
hull = ConvexHull(Points=flatten(pt_6), Plane=xz)  # -> Hull, HullZ, Indices
number_slider_8 = Slider(0.1, range=0..1)
number_slider_9 = Slider(0.5, range=0..1)
toggle = BooleanToggle(False)
toggle_2 = BooleanToggle(True)
brep_3 = Brep(hull.Hull)
radiationanalysis = Ladybug_RadiationAnalysis(
    geometry=flatten(brep_3),
    context=flatten(onlybreps.A),
    gridSize=number_slider_8,
    disFromBase=number_slider_8,
    selectedSkyMtx=flatten(selectskymtx.selectedSkyMtx),
    parallel=toggle_2,
    runIt=toggle_2)  # -> readMe, contextMesh, analysisMesh, testPts, testVec, port, radiationResult, radiationMesh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; plug-in component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
sunlighthoursanalysis = Ladybug_SunlightHoursAnalysis(
    geometry=flatten(brep_2),
    context=flatten(brep_2),
    gridSize=number_slider_9,
    disFromBase=number_slider_9,
    sunVectors=flatten(sunpath.sunVectors),
    timeStep=1,
    parallel=toggle,
    runIt=toggle)  # -> readMe, contextMesh, analysisMesh, testPts, testVec, port, sunlightHoursResult, sunlightHoursMesh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; plug-in component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

# ---- group: GottaLearnHowToCrawlBeforeYouCanRun...
# You can replace the mesh with a different
# pattern, and choose edges from it to assign
# to mountain or valley folds.
# To start, Press the 'Reset' button below  then slowly change the 'Folding' slider.
number_slider_10 = Slider(2, range=0..50)  # disabled
number_slider_11 = Slider(2, range=0..10)  # disabled
xz_2 = XZPlane(Origin=Point(0, 0, 0))  # disabled
xz_3 = XZPlane(Origin=Point(0, 0, 0))  # disabled
square = Square(Plane=xz_2, Size=1, ExtentX=number_slider_10, ExtentY=number_slider_10)  # -> Cells, Points; disabled
addition = Addition(A=number_slider_11, B=number_slider_10)  # disabled
subtraction = Subtraction(A=addition, B=number_slider_11)  # disabled
points_2 = PointList(Points=square.Points)  # disabled
panel_2 = Panel(square.Points)  # disabled
number_slider_12 = Slider(0.08106, range=0..1)  # disabled
addition_2 = Addition(A=subtraction, B=number_slider_12)  # disabled
X_3 = UnitX(Factor=addition_2)  # disabled
folding_3 = Slider(0.99, range=0..0.99)  # disabled
folding_4 = Slider(0.99, range=0..0.99)  # disabled
angle_3 = Panel("pi")  # disabled
angle_4 = Panel("-pi")  # disabled
multiplication_3 = Multiplication(A=angle_3, B=folding_3)  # disabled
multiplication_4 = Multiplication(A=angle_4, B=folding_3)  # disabled
toggle_3 = BooleanToggle(True)  # disabled
reset_2 = Button()  # disabled

# ---- group: SomeComponentsWeMightOrMightNotNeed
point_2 = Point(square.Points)  # disabled
branchrearrange_6 = CSharpScript()  # -> A; inputs number: tree of Double; disabled
# ---------- branchrearrange_6: C# ----------
    var doubleOut = new DataTree<double>();

    for( int i = 0; i < number.BranchCount; ++i )
      for( int j = 0; j < number.Branch(i).Count; ++j )
      {

        doubleOut.Add(number.Branch(i)[j], new GH_Path(j));

      }

    A = doubleOut;
# ---------- end branchrearrange_6 ----------
meshing = CSharpScript()  # -> Mesh; inputs points: list of Point3d; disabled
# ---------- meshing: C# ----------
    var mesh = new Mesh();

    mesh.Vertices.AddVertices(points);

    //for( int i = 0; i < 2; ++i )
    //{

      mesh.Faces.AddFace( 4, 1, 0 );

      mesh.Faces.AddFace( 4, 2, 1 );

      mesh.Faces.AddFace( 4, 2, 5 );
      
      mesh.Faces.AddFace( 4, 5, 8 );
    
      mesh.Faces.AddFace( 4, 8, 7 );
    
      mesh.Faces.AddFace( 4, 7, 6 );

      mesh.Faces.AddFace( 4, 6, 3 );
    
      mesh.Faces.AddFace( 4, 0, 3 );
    
    //}

    Mesh = mesh;
# ---------- end meshing ----------
mesher = CSharpScript()  # -> meshOut, A; inputs points: list of Point3d, dis: Double; disabled
# ---------- mesher: C# ----------
    var mesh = new Mesh();

    int size = points.Count;

    var organized = Point3d.SortAndCullPointList(points, 0.001);

    mesh.Vertices.AddVertices(organized);

    double distance = organized[0].DistanceTo(organized[1]);

    if( AlmostEqualTo( distance, dis ) == false )
    {

      mesh.Faces.AddFace(0, 1, 12);
      mesh.Faces.AddFace(0, 1, 2);
      mesh.Faces.AddFace(0, 2, 3, 4);
      mesh.Faces.AddFace(0, 4, 5);
      mesh.Faces.AddFace(0, 5, 6);
      mesh.Faces.AddFace(0, 6, 7);
      mesh.Faces.AddFace(0, 7, 8);
      mesh.Faces.AddFace(0, 8, 9, 10);
      mesh.Faces.AddFace(0, 10, 11);
      mesh.Faces.AddFace(0, 11, 12);

    }

    else
    {

      mesh.Faces.AddFace(12, 0, 1);
      mesh.Faces.AddFace(12, 1, 2);
      mesh.Faces.AddFace(12, 2, 3, 4);
      mesh.Faces.AddFace(12, 4, 5);
      mesh.Faces.AddFace(12, 5, 6);
      mesh.Faces.AddFace(12, 6, 7);
      mesh.Faces.AddFace(12, 7, 8);
      mesh.Faces.AddFace(12, 8, 9, 10);
      mesh.Faces.AddFace(12, 10, 11);
      mesh.Faces.AddFace(12, 11, 0);

    }

    meshOut = mesh;

    A = organized;
# ---------- mesher: C# additional code ----------
  public static bool AlmostEqualTo(double value1, double value2)
  {
    return Math.Abs(value1 - value2) < 0.0000001; 
  }
# ---------- end mesher ----------
number_slider_13 = Slider(0, range=0..100)  # disabled
c_script_6 = CSharpScript()  # -> A; inputs points: list of Point3d; disabled
# ---------- c_script_6: C# ----------
    var pointsOut = new List<Point3d>();
    
    var size = points.Count;
    
    for( int i = 0; i < size; ++i )
    {
      
      if( i % 3 != 1 )
      {
        
        pointsOut.Add( points[i] );
      
      }
      
    }
    
    A = pointsOut;
# ---------- end c_script_6 ----------
boolean_toggle = BooleanToggle(True)  # disabled
c_script_7 = CSharpScript(points=point_2)  # -> selectedPoints; inputs points: tree of Point3d; disabled; same code as c_script_5
c_script_8 = CSharpScript(Reference="C:\Users\feli2\AppData\Roaming\Grasshopper\Libraries\KangarooSolver.dll")  # -> out, A, B; inputs x: list; disabled
# ---------- c_script_8: C# ----------
    
    var PS = new KangarooSolver.PhysicalSystem();
    double tol = 0.0001; // points closer than this will get combined into a single particle
    var GoalList = new List<IGoal>();

    //Assign indexes to the particles in each Goal:
    foreach(IGoal G in x)
    {
      PS.AssignPIndex(G, tol);
      GoalList.Add(G);
    }

    int counter = 0;
    double threshold = 1e-10;
    do
    {
      PS.Step(GoalList, false, threshold); // The step will iterate until either reaching 15ms or the energy threshold
      counter++;
    }while(PS.GetvSum() > threshold && counter < 100); //GetvSum returns the current kinetic energy
    // always include a counter to prevent it getting stuck forever in case it cannot reach the given threshold

    A = PS.GetOutput(GoalList);
    B = counter;
# ---------- end c_script_8 ----------
path = ConstructPath(Indices=number_slider_13)  # disabled
branch = TreeBranch(Path=path, MaintainPaths=True)  # disabled
getmebranches = CSharpScript(tree=square.Points, clockWise=boolean_toggle)  # -> A; inputs tree: tree of Point3d, clockWise: Boolean; disabled
# ---------- getmebranches: C# ----------
    var linesOut = new DataTree<Point3d>();

    var branches = tree.BranchCount;

    int x = 0, y = 0;

    bool flag = clockWise;

    if( flag == true )
    {

      x = 0; y = 1;

    }

    if( flag == false )
    {

      x = 1; y = 0;

    }

    for( int i = 0; i < branches; ++i )
      for( int j = 0; j < tree.Branch(i).Count; ++j )
      {

        var path = new GH_Path(i);

        if( i % 2 != 0 && j % 2 != x )
          if( flag == true )

            linesOut.Add(tree.Branch(i)[j], path);

          else
          {

            linesOut.Add(tree.Branch(i)[j], path);

          }

        if( i % 2 != 1 && j % 2 != y )
          if( flag == true )

            linesOut.Add(tree.Branch(i)[j], path);

          else
          {

            linesOut.Add(tree.Branch(i)[j], path);

          }

      }

    A = linesOut;
# ---------- end getmebranches ----------
unit_z = UnitZ(Factor=1)  # disabled
goalsbrancher = CSharpScript(Reference="C:\Users\feli2\AppData\Roaming\Grasshopper\Libraries\KangarooSolver.dll")  # -> A; inputs goals: tree; disabled
# ---------- goalsbrancher: C# ----------
    PS = new KangarooSolver.PhysicalSystem();
    
    for( int i = 0; i < goals.BranchCount; ++i )
      for( int j = 0; j < goals.Branch(i).Count; ++j )
      {

        goalsOut.Add(goals.Branch(i)[j], new GH_Path(i));

      }

    /*
    for( int i = 0; i < goals.Count; ++i )
    {

      goalsOut.Add(goals[i], new GH_Path(i));

    }
    */

    A = goalsOut;
# ---------- goalsbrancher: C# additional code ----------
  KangarooSolver.PhysicalSystem PS = new KangarooSolver.PhysicalSystem();
  DataTree<object> goalsOut = new DataTree<object>();
# ---------- end goalsbrancher ----------
c_script_9 = CSharpScript(points=branch)  # -> meshOut, A; inputs points: list of Point3d; disabled
# ---------- c_script_9: C# ----------
    var mesh = new Mesh();

    int size = points.Count;

    var organized = Point3d.SortAndCullPointList(points, 0.001);

    mesh.Vertices.AddVertices(organized);

    mesh.Faces.AddFace(0, 1, 12);
    mesh.Faces.AddFace(0, 1, 2);
    mesh.Faces.AddFace(0, 2, 3, 4);
    mesh.Faces.AddFace(0, 4, 5);
    mesh.Faces.AddFace(0, 5, 6);
    mesh.Faces.AddFace(0, 6, 7);
    mesh.Faces.AddFace(0, 7, 8);
    mesh.Faces.AddFace(0, 8, 9, 10);
    mesh.Faces.AddFace(0, 10, 11);
    mesh.Faces.AddFace(0, 11, 12);
    
    /*
    for( int i = 0; i < size; ++i )
    {

      mesh.Faces.AddFace(0, i + 1, i + 2, i + 3);

      //if( i == size - 1 )

        //mesh.Faces.AddFace(0, 1, size - 1);

    }
    */

    meshOut = mesh;

    A = organized;
# ---------- end c_script_9 ----------
number_slider_14 = Slider(0.1407, range=0..1)  # disabled
number_slider_15 = Slider(1, range=0..1)  # disabled
move_12 = Move(Geometry=c_script_7, Motion=unit_z)  # -> Geometry, Transform; disabled
goalsbrancher_2 = CSharpScript(Reference="C:\Users\feli2\AppData\Roaming\Grasshopper\Libraries\KangarooSolver.dll")  # -> A; inputs goals: tree; disabled; same code as goalsbrancher
points_3 = PointList(Points=c_script_9.A, Size=number_slider_14)  # disabled
customiteration = CSharpScript(Reference="D:\DOWNLOADS\KANGAROO242\KangarooSolver.dll")  # -> out, A, B; inputs x: list; disabled
# ---------- customiteration: C# ----------
    var PS = new KangarooSolver.PhysicalSystem();
    double tol = 0.0001; // points closer than this will get combined into a single particle
    var GoalList = new List<IGoal>();

    //Assign indexes to the particles in each Goal:
    foreach(IGoal G in x)
    {
      PS.AssignPIndex(G, tol);
      GoalList.Add(G);
    }

    int counter = 0;
    double threshold = 1e-10;
    do
    {
      PS.Step(GoalList, false, threshold); // The step will iterate until either reaching 15ms or the energy threshold
      counter++;
    }while(PS.GetvSum() > threshold && counter < 100); //GetvSum returns the current kinetic energy
    // always include a counter to prevent it getting stuck forever in case it cannot reach the given threshold

    A = PS.GetOutput(GoalList);
    B = counter;
# ---------- end customiteration ----------
point_list = PointList(Points=getmebranches, Size=number_slider_15)  # disabled
point_list_2 = PointList(Points=c_script_7, Size=number_slider_15)  # disabled

# ---- group: GottaLearnHowToCrawlBeforeYouCanRun... / ThisAintThePrettiestButItGetsThingsDone
boolean_toggle_2 = BooleanToggle(False)  # disabled
panel_3 = Panel("{0;0;1}")  # disabled
panel_4 = Panel("{0;0;1}(-1)")  # disabled
panel_5 = Panel("{0;0;0}[+1]")  # disabled
panel_6 = Panel("{0;0;+1}[+1]")  # disabled
relative_item = RelativeItem(Tree=square.Points, Offset=panel_3, WrapPaths=boolean_toggle_2, WrapItems=boolean_toggle_2)  # -> ItemA, ItemB; disabled
relative_item_2 = RelativeItem(Tree=square.Points, Offset=panel_5, WrapPaths=boolean_toggle_2, WrapItems=boolean_toggle_2)  # -> ItemA, ItemB; disabled
relative_item_3 = RelativeItem(Tree=square.Points, Offset=panel_6, WrapPaths=boolean_toggle_2, WrapItems=boolean_toggle_2)  # -> ItemA, ItemB; disabled
relative_item_4 = RelativeItem(Tree=square.Points, Offset=panel_4, WrapPaths=boolean_toggle_2, WrapItems=boolean_toggle_2)  # -> ItemA, ItemB; disabled

# ---- group: GottaLearnHowToCrawlBeforeYouCanRun... / GiveMeThemLines
line_4 = Line(StartPoint=relative_item_3.ItemA, EndPoint=relative_item_3.ItemB)  # -> simplify(Line); disabled
line_5 = Line(StartPoint=relative_item_4.ItemA, EndPoint=relative_item_4.ItemB)  # -> simplify(Line); disabled
line_6 = Line(StartPoint=relative_item_2.ItemA, EndPoint=relative_item_2.ItemB)  # -> simplify(Line); disabled
boolean_toggle_3 = BooleanToggle(True)  # disabled
boolean_toggle_4 = BooleanToggle(False)  # disabled
line_7 = Line(StartPoint=relative_item.ItemA, EndPoint=relative_item.ItemB)  # -> simplify(Line); disabled
c_script_10 = CSharpScript(lines=line_6)  # -> linesOut; inputs lines: tree of Line; disabled
# ---------- c_script_10: C# ----------
    int branches = lines.BranchCount;

    var newLines = new DataTree<Line>();
    
    var p = new int[branches];
    
    for( int i = 0; i < branches; ++i )
    {

      for( int j = 0; j < lines.Branch(i).Count; ++j )
      {

        if( i % 2 != 1 )
        {

          newLines.Add(lines.Branch(i)[j], new GH_Path(i/2));

        }
        
      }

    }

    linesOut = newLines;
# ---------- end c_script_10 ----------
getmebranches_2 = CSharpScript(tree=line_4, clockWise=boolean_toggle_3)  # -> A; inputs tree: tree of Line, clockWise: Boolean; disabled
# ---------- getmebranches_2: C# ----------
    var linesOut = new DataTree<Line>();

    var branches = tree.BranchCount;

    int x = 0, y = 0;

    bool flag = clockWise;

    if( flag == true )
    {

      x = 0; y = 1;

    }

    if( flag == false )
    {

      x = 1; y = 0;

    }

    for( int i = 0; i < branches; ++i )
      for( int j = 0; j < tree.Branch(i).Count; ++j )
      {

        var path = new GH_Path(i);

        if( i % 2 != 0 && j % 2 != x )
          if( flag == true )

            linesOut.Add(tree.Branch(i)[j], path);

          else
          {

            linesOut.Add(tree.Branch(i)[j], path);

          }

        if( i % 2 != 1 && j % 2 != y )
          if( flag == true )

            linesOut.Add(tree.Branch(i)[j], path);

          else
          {

            linesOut.Add(tree.Branch(i)[j], path);

          }

      }

    A = linesOut;
# ---------- end getmebranches_2 ----------
getmebranches_3 = CSharpScript(tree=line_5, clockWise=boolean_toggle_4)  # -> A; inputs tree: tree of Line, clockWise: Boolean; disabled; same code as getmebranches_2

# ---- group: GottaLearnHowToCrawlBeforeYouCanRun... / GiveMeAMesh
number_slider_16 = Slider(4, range=0..5)  # disabled
line_8 = Line([line_7, getmebranches_2, getmebranches_3, c_script_10])  # disabled
weaverbird_s_mesh_from_lines_weave_back = WeaverbirdsMeshFromLinesWeaveBack(Lines=flatten(line_8), MaximumValence=number_slider_16)  # disabled

# ---- group: GottaLearnHowToCrawlBeforeYouCanRun... / AnchorPointsWeWantThemFixed
c_script_11 = CSharpScript(lines=line_6)  # -> linesOut; inputs lines: tree of Line; disabled
# ---------- c_script_11: C# ----------
    int branches = lines.BranchCount;

    var newLines = new DataTree<Line>();

    for( int i = 0; i < branches; ++i )
      for( int j = 0; j < lines.Branch(i).Count; ++j )
      {

        var path = new GH_Path(i);

        if( i % 2 != 0 )

          newLines.Add(lines.Branch(i)[j], path);

      }

    linesOut = newLines;
# ---------- end c_script_11 ----------
c_script_12 = CSharpScript(lines=line_7)  # -> linesOut; inputs lines: tree of Line; disabled
# ---------- c_script_12: C# ----------
    int branches = lines.BranchCount;

    var newLines = new DataTree<Line>();

    var p = new int[branches];

    for( int i = 0; i < branches; ++i )
    {

      for( int j = 0; j < lines.Branch(i).Count; ++j )
      {

        if( j % 2 != 1 )
        {

          newLines.Add(lines.Branch(i)[j], new GH_Path(j/2));

        }

      }

    }

    linesOut = newLines;
# ---------- end c_script_12 ----------
join_2 = JoinCurves(Curves=c_script_11, Preserve=False)  # disabled
join_3 = JoinCurves(Curves=c_script_12, Preserve=False)  # disabled
join_4 = JoinCurves(Curves=c_script_10, Preserve=False)  # disabled
end = EndPoints(Curve=join_2)  # -> Start, End; disabled
ccx = CurveCurve(CurveA=flatten(join_3), CurveB=join_4)  # -> flatten(Points), ParamsA, ParamsB; disabled
pt_7 = Point(flatten([end.Start, end.End, ccx.Points]))  # disabled

# ---- group: GottaLearnHowToCrawlBeforeYouCanRun... (continued)
crv_6 = Curve([getmebranches_2, getmebranches_3])  # disabled
move_13 = Move(Geometry=crv_6, Motion=X_3)  # -> Geometry, Transform; disabled
crv_7 = Curve([line_7, c_script_10])  # disabled
move_14 = Move(Geometry=crv_7, Motion=X_3)  # -> Geometry, Transform; disabled
move_15 = Move(Geometry=weaverbird_s_mesh_from_lines_weave_back, Motion=X_3)  # -> Geometry, Transform; disabled
move_16 = Move(Geometry=pt_7, Motion=X_3)  # -> Geometry, Transform; disabled
anchor_2 = Anchor(Point=[pt_7, move_16.Geometry], Strength=10000)  # disabled

# ---- group: GottaLearnHowToCrawlBeforeYouCanRun... / mesh of flat folding pattern
mesh_4 = Mesh(simplify(graft([weaverbird_s_mesh_from_lines_weave_back, move_15.Geometry])))  # disabled

# ---- group: GottaLearnHowToCrawlBeforeYouCanRun... / Mountain fold lines
crv_8 = Curve([crv_6, move_13.Geometry])  # disabled

# ---- group: GottaLearnHowToCrawlBeforeYouCanRun... / Valley fold lines
crv_9 = Curve([crv_7, move_14.Geometry])  # disabled

# ---- group: GottaLearnHowToCrawlBeforeYouCanRun...
multiplication_5 = Multiplication(A=angle_3, B=folding_4)  # disabled
hingepoints_2 = HingePoints(Mesh=mesh_4)  # -> _1, _2, _3, _4; disabled
multiplication_6 = Multiplication(A=angle_4, B=folding_4)  # disabled
ln_3 = Line(StartPoint=hingepoints_2._1, EndPoint=hingepoints_2._2)  # disabled
hinge_3 = Hinge(
    FoldStart=hingepoints_2._1,
    FoldEnd=hingepoints_2._2,
    Tip1=hingepoints_2._3,
    Tip2=hingepoints_2._4,
    RestAngle=simplify(graft([multiplication_5, multiplication_3])),
    Strength=0.1)  # disabled
hinge_4 = Hinge(
    FoldStart=hingepoints_2._1,
    FoldEnd=hingepoints_2._2,
    Tip1=hingepoints_2._3,
    Tip2=hingepoints_2._4,
    RestAngle=simplify(graft([multiplication_6, multiplication_4])),
    Strength=0.1)  # disabled
show_2 = Show(G=mesh_4)  # disabled
eval_6 = EvaluateCurve(Curve=reparameterize(crv_9), Parameter=0.5)  # -> Point, Tangent, Angle; disabled
eval_7 = EvaluateCurve(Curve=reparameterize(crv_8), Parameter=0.5)  # -> Point, Tangent, Angle; disabled
eval_8 = EvaluateCurve(Curve=ln_3, Parameter=0.5)  # -> graft(Point), Tangent, Angle; disabled
dist_3 = Distance(PointA=eval_6.Point, PointB=eval_8.Point)  # disabled
dist_4 = Distance(PointA=eval_7.Point, PointB=eval_8.Point)  # disabled
sort_3 = SortList(Keys=dist_3)  # -> Keys, ValuesA; disabled
sort_4 = SortList(Keys=dist_4)  # -> Keys, ValuesA; disabled
item_4 = ListItem(List=sort_3.Keys, Index=0, Wrap=True)  # disabled
item_5 = ListItem(List=sort_4.Keys, Index=0, Wrap=True)  # disabled
smaller_3 = SmallerThan(FirstNumber=item_4, SecondNumber=0.01)  # -> flatten(SmallerThan), OrEqualTo; disabled
smaller_4 = SmallerThan(FirstNumber=item_5, SecondNumber=0.01)  # -> flatten(SmallerThan), OrEqualTo; disabled
cull_3 = CullPattern(List=hinge_3, CullPattern=smaller_4.SmallerThan)  # disabled
cull_4 = CullPattern(List=hinge_4, CullPattern=smaller_3.SmallerThan)  # disabled

# ---- group: GottaLearnHowToCrawlBeforeYouCanRun... / maintain edge lengths
medges_3 = MeshEdges(Mesh=mesh_4)  # -> NakedEdges, InteriorEdges, NonManifoldEdges; disabled
length_line_2 = LengthLine(Line=[medges_3.NakedEdges, medges_3.InteriorEdges], Strength=1)  # disabled

# ---- group: GottaLearnHowToCrawlBeforeYouCanRun... / a weak plastic anchor on all points prevents drift
demesh_2 = DeconstructMesh(Mesh=mesh_4)  # -> Vertices, Faces, Colours, Normals; disabled
plasticanchor_2 = PlasticAnchor(Point=demesh_2.Vertices, Limit=0.01, Strength=0.001)  # disabled

# ---- group: GottaLearnHowToCrawlBeforeYouCanRun... (continued)
data_2 = Data([length_line_2, cull_4, cull_3, show_2, plasticanchor_2, anchor_2])  # disabled
solver_2 = Solver(GoalObjects=data_2, Reset=reset_2, Threshold=1e-15, Tolerance=0.01, On=toggle_3)  # -> I, V, O; disabled
