# Grasshopper definition FacadeMechanism.gh (Grasshopper 0.9.76)

number_slider = Slider(5, range=0..5)
pt = ConstructPoint(XCoordinate=0, YCoordinate=0, ZCoordinate=Slider(1.728, range=0..10))
number_slider_2 = Slider(10, range=0..10)
cir = Circle(Plane=pt, Radius=number_slider)
Z = UnitZ(Factor=number_slider_2)  # -> expr("x*0.2", UnitVector)
log = Logarithm(Value=number_slider_2)
multiplication = Multiplication(A=Z, B=number_slider_2)
Z_2 = UnitZ(Factor=Slider(1.608, range=0..2))  # -> expr("-x", UnitVector)
number_slider_3 = Slider(3, range=0..10)
move = Move(Geometry=pt, Motion=expr("-x", Z))  # -> Geometry, Transform
cir_2 = Circle(Plane=move.Geometry, Radius=number_slider)
scale = Scale(Geometry=cir_2, Center=Point(0, 0, 0), Factor=log)  # -> Geometry, Transform
move_2 = Move(Geometry=scale.Geometry, Motion=expr("-x", multiplication))  # -> Geometry, Transform
move_3 = Move(Geometry=move.Geometry, Motion=expr("-x", Z))  # -> Geometry, Transform
divide = DivideCurve(Curve=cir, Count=number_slider_3, Kinks=False)  # -> Points, Tangents, Parameters
divide_2 = DivideCurve(Curve=move_2.Geometry, Count=number_slider_3, Kinks=False)  # -> Points, Tangents, Parameters
shift = ShiftList(List=divide.Points, Shift=1, Wrap=True)
ln = Line(StartPoint=divide.Points, EndPoint=shift)
move_4 = Move(Geometry=ln, Motion=expr("-x", Z))  # -> Geometry, Transform
divide_3 = DivideCurve(Curve=move_4.Geometry, Count=Slider(2, range=0..3), Kinks=False)  # -> Points, Tangents, Parameters
item = ListItem(List=divide_3.Points, Index=Slider(1, range=0..1), Wrap=True)
pt_2 = Point([item, divide.Points])
ln_2 = Line(StartPoint=move_3.Geometry, EndPoint=pt_2)
ln_3 = Line(StartPoint=move.Geometry, EndPoint=[item, divide.Points])
end = EndPoints(Curve=flatten(ln_3))  # -> Start, End
item_2 = ListItem(List=end.End, Index=0, Wrap=True)  # -> Item, Item1, Item2, Item3, Item4, Item5
join = JoinCurves(Curves=[ln_3, ln_2], Preserve=False)
pt_3 = Point(item_2.Item)
pt_4 = Point(item_2.Item1)
pt_5 = Point(item_2.Item2)
pt_6 = Point(item_2.Item3)
pt_7 = Point(item_2.Item4)
pt_8 = Point(item_2.Item5)
pipe = Pipe(Curve=join, Radius=Slider(0.047, range=0..1), Caps=0)
del = DelaunayMesh(Points=[pt_6, pt_3, move.Geometry], Plane=PlaneXY(0, 0, 0))
del_2 = DelaunayMesh(Points=[pt_8, pt_3, move.Geometry], Plane=PlaneXY(0, 0, 0))
del_3 = DelaunayMesh(Points=[pt_8, pt_5, move.Geometry], Plane=PlaneXY(0, 0, 0))
del_4 = DelaunayMesh(Points=[pt_7, pt_5, move.Geometry], Plane=PlaneXY(0, 0, 0))
del_5 = DelaunayMesh(Points=[pt_4, pt_7, move.Geometry], Plane=PlaneXY(0, 0, 0))
del_6 = DelaunayMesh(Points=[pt_4, pt_6, move.Geometry], Plane=PlaneXY(0, 0, 0))
area = Area(Geometry=del)  # -> Area, Centroid
panel = Panel(area.Area)
